# Grasshopper definition grasshopper.gh (Grasshopper 1.0.7)

geo = Geometry([<mesh referenced from the Rhino model> x3, <brep referenced from the Rhino model>, <mesh referenced from the Rhino model>])
geo_2 = Geometry([<mesh referenced from the Rhino model> x3, <brep referenced from the Rhino model>, <mesh referenced from the Rhino model>])
Y = UnitY(Factor=Slider(0, range=-13..0))
move = Move(Geometry=geo_2, Motion=Y)  # -> Geometry, Transform
preview = CustomPreview(
    Geometry=move.Geometry,
    Material=Tree({0}: [{diffuse=RGB(176, 224, 230), emission=RGB(66, 48, 66), shine=0.5, specular=RGB(255, 255, 255), transparency=0}], {1}: []))
